vi "FrontPanel.gvi"   [LabVIEW NXG 3.1.0]
panel controls:
  "Pattern Size": f64[2]
  "Display position": f64[]
  "Show display": bool
  "Spot positions": f64[][]
  "Stop": bool
  "err Input": error
panel indicators:
  "Pattern": f64[][]
  "err Output": error
uses:
  otslm::initOtslm.mli::initOtslm
  PrismsAndLenses::GenerateImages.gvi
  otslm::tools::combine.gvi
  otslm::tools::finalize.gvi
diagram:
  s1 = $"err Input"  # shift register
  while {
    call "initOtslm"(error in=s1) -> (error out=w1)
    call "GenerateImages.gvi"(sz=$"Pattern Size", positions=$"Spot positions", error in=w1) -> (Image array=w2, error out=w3)
    call "combine.gvi"(inputs=w2, error in=w3) -> (im=w4, error out=w5)
    call "finalize.gvi"(input=w4, error in=w5) -> (im=w6, error out=w7)
    case ($"Show display") {
      frame False, Default { }
      frame True {
        # TODO: Finish this
      }
    }
    $Pattern <- w6
    next s1 = w7
    stop if $Stop
  }
  $"err Output" <- s1
