vi "GenerateImages.gvi"   [LabVIEW NXG 3.1.0]
inputs:
  "sz": f64[2]
  "positions": f64[][]
  "error in": error
outputs:
  "error out": error
  "Image array": f64[][][]
uses:
  otslm::simple::linear.gvi
  otslm::simple::spherical.gvi
diagram:
  s1 = $"error in"  # shift register
  for {
    w1 = each element of $positions
    Array Index(array=w1) -> (out0[0]=w3, out1[1]=w4, out2[2]=w5)
    Build Array(w3, w4) -> w6
    Divide(x=[1, 1], y=w6) -> w7
    call "linear.gvi"(sz=$sz, spacing=w7, error in=s1) -> (im=w8, error out=w9)
    Array Max And Min(array=$sz) -> (max value=w10)
    Divide(x=w10, y=2) -> w11
    Build Array(w11, w11) -> w12
    call "spherical.gvi"(sz=$sz, radius=w11, centre=w12, scale=w5, error in=w9) -> (im=w13, error out=w14)
    Add(w8, w13) -> w15
    append w15 to w2
    next s1 = w14
  }
  $"Image array" <- w2
  $"error out" <- s1
