vi "linear.gvi"   [LabVIEW NXG 3.1.0]
inputs:
  "error in": error
  "sz": f64[]
  "spacing": f64[]
outputs:
  "error out": error
  "im": f64[][]
panel indicators:
  "Intensity Graph": f64[][]
uses:
  otslm::simple::linear.mli::otslm.simple.linear
  otslm::tools::finalize.gvi
diagram:
  call "otslm.simple.linear"(sz=$sz, spacing=$spacing, error in=$"error in") -> (im=w1, error out=w2)
  call "finalize.gvi"(input=w1, error in=w2) -> (im=w3)
  $"Intensity Graph" <- w3
  $im <- w1
  $"error out" <- w2
