vi "spherical.gvi"   [LabVIEW NXG 3.1.0]
inputs:
  "error in": error
  "sz": f64[]
  "radius": f64
  "centre": f64[]
  "scale": f64
  "type": string
outputs:
  "error out": error
  "im": f64[][]
panel indicators:
  "Intensity Graph": f64[][]
uses:
  otslm::simple::spherical.mli::otslm.simple.spherical
  otslm::tools::finalize.gvi
diagram:
  call "otslm.simple.spherical"(sz=$sz, radius=$radius, centre_str="centre", centre=$centre, type_str="type", type=$type, scale_str="scale", scale=$scale, error in=$"error in") -> (im=w1, error out=w2)
  call "finalize.gvi"(input=w1, error in=w2) -> (im=w3)
  $"Intensity Graph" <- w3
  $im <- w1
  $"error out" <- w2
